# Dynamo graph AUTOMAÇÃO DO DIMENSIONAMENTO, MODELAGEM E DETALHAMENTO DE ELEMENTOS DE FUNDAÇÃO DO TIPO SAPATA ISOLADA UTILIZANDO SOFTWARE REVIT E INTERFACE DE PROGRAMAÇÃO VISUAL DYNAMO.dyn (Dynamo 2.19.3.6394)
# author: Luciano Rosa dos Santos Silva
# PARA O USO:                                                                                01. Antes de executar a rotina, importe as famílias disponibilizadas no link.                                                                                   02) Defina o valor de carga, bitola e marca (identificação) de cada pilar.                                                                                03. Escolha uma pasta para os relatórios de cálculo serem salvos.                                                                                                 04. Sempre selecione o pilar antes de iniciar a rotina. OBSERVAÇÃO IMPORTANTE: os valores de marca (identificação de cada pilar) devem ser diferentes.
# packages: BIM4Struc.Productivity 2.7.0, BIMCoder Nodes - 2.X 2025.8.0, Clockwork for Dynamo 2.x 2.12.3

# group: ENCONTRAR E SELECIONAR O PILAR QUE DESEJA DIMENSIONAR A SAPATA
# Observação: é impotante que os valores de parâmetros para o dimensionamento sejam inseridos!
n12_selecione_o_pilar_que_deseja = DSModelElementByCategorySelection("OST_StructuralColumns")  # "12 - SELECIONE O PILAR QUE DESEJA DIMENSIONAR A FUNDAÇÃO"; 1 picked in the model; graph input

# group: IDENTIFICAÇÃO DE LOCAL DE MODELAGEM DA SAPATA
# Observação: a sapata vai ser modelada nas coordenadas X e Y do pilar e com elevação igual ao deslocamento da base do pilar.
familyinstance_location = FamilyInstance.Location(familyInstance=n12_selecione_o_pilar_que_deseja)  # "FamilyInstance.Location (corddenadas X e y do pilar)"
X = Point.X(point=familyinstance_location)
Y = Point.Y(point=familyinstance_location)
string = StringInput("Deslocamento da base")
getParameterValueByName = Element.GetParameterValueByName(element=n12_selecione_o_pilar_que_deseja, parameterName=string)

# group: INSERIR FAMÍLIA DE SAPATA NA COORDENADA
# Observação: esse nó insere a família carregada de sapata
string_2 = StringInput("FAMÍLIA - SAPATA ISOLADA PARAMETRIZADA")
byName = FamilyType.ByName(name=string_2)
byCoordinates = FamilyInstance.ByCoordinates(familyType=byName, x=X, y=Y, z=getParameterValueByName)

# group: ROTAÇÃO DA SAPATA
# Descrição <Clique duas vezes aqui para editar a descrição do grupo>
rotationAngle = Custom[Element.RotationAngle](element=n12_selecione_o_pilar_que_deseja)  # package BIM4Struc.Productivity; Get the rotation element of a Revit element. The rotation angle is based on the Location.Rotation property in the RevitAPI. If Location is not equal to a LocationPoint (ie. in case of slanted columns) then the Angle will be set to null.
setRotation = FamilyInstance.SetRotation(familyInstance=byCoordinates, degree=rotationAngle)

# group: RENOMEAR A SAPATA DE ACORDO COM O NOME PILAR
# Observação: a sapata locada terá o some com prefixo "SAPATA DE" e sufixo igual ao identificador do pilar, especificado como marca. Dessa forma é importante inserir o parâmetro marca do pilar para nomear a sapata automaticamente.
string_3 = StringInput("S")
string_4 = StringInput("Marca")
getParameterValueByName_2 = Element.GetParameterValueByName(element=n12_selecione_o_pilar_que_deseja, parameterName=string_4)
concat = String.Concat(string0=string_3, string1=getParameterValueByName_2)

# group: DUPLICAR E SUBSTITUIR A SAPATA LOCADA COM O NOME DE ACORDO COM O PILAR
# Observação: aqui ocorre a substituição da sapata locada por uma cópia que, altomaticamente, possua o nome relacionado ao pilar selecionado.  É um padrão muito mais claro e descritivo, o que ajuda na organização do projeto e na leitura das tabelas de quantitativos.
string_5 = StringInput("Tipo")
elementType = Element.ElementType(element=setRotation)
duplicate = ElementType.Duplicate(elementType=elementType, name=concat)
setParameterByName = Element.SetParameterByName(element=setRotation, parameterName=string_5, value=duplicate)

# group: BUSCAR O TIPO DE FAMÍLIA ANALISADA
# Descrição <Clique duas vezes aqui para editar a descrição do grupo>
n01_elemento_estrutural = Element.ElementType(element=setParameterByName)  # "01 - ELEMENTO ESTRUTURAL DIMENSIONADO E MODELADO: OK!"
n01_elemento_estrutural_2 = Watch(n01_elemento_estrutural)  # "01 - ELEMENTO ESTRUTURAL DIMENSIONADO E MODELADO: OK!"; graph output

# group: EXTRAÇÃO DE DADOS DO PILAR
# Descrição <Clique duas vezes aqui para editar a descrição do grupo>
string_6 = StringInput("Nk (Carga no pilar)")
getParameterValueByName_3 = Element.GetParameterValueByName(element=n12_selecione_o_pilar_que_deseja, parameterName=string_6)
elementType_2 = Element.ElementType(element=n12_selecione_o_pilar_que_deseja)
string_7 = StringInput("h")
getParameterValueByName_4 = Element.GetParameterValueByName(element=elementType_2, parameterName=string_7)
elementType_3 = Element.ElementType(element=n12_selecione_o_pilar_que_deseja)
string_8 = StringInput("b")
getParameterValueByName_5 = Element.GetParameterValueByName(element=elementType_3, parameterName=string_8)
string_9 = StringInput("Øℓp (Diâmetro da armadura longitudinal do pilar)")
getParameterValueByName_6 = Element.GetParameterValueByName(element=n12_selecione_o_pilar_que_deseja, parameterName=string_9)

# group: INSERÇÃO MANUAL DE CARACTERÍSTICAS GEOMÉTRICAS E DE MATERIAIS DO ELEMENTO.
# Descrição <Clique duas vezes aqui para editar a descrição do grupo>
n04_método_de_dimensionamento = BoolSelector(true)  # "04 - Método de dimensionamento (Verdadeiro= Balanços Iguais ou Falso=Proporção do Pilar)"; graph input
n06_tensão_admissível_do_solo_kgf = DoubleInput(0)  # "06- Tensão admissível do solo (kgf/cm²)"; graph input
n05_cobrimento_de_armadura_cm = DoubleInput(0)  # "05- Cobrimento de armadura (cm)"; graph input
n07_diâmetro_da_armadura = DoubleInput(0)  # "07 - Diâmetro da armadura distribuída ao longo da maior dimençao (mm)"; graph input
n08_diâmetro_da_armadura = DoubleInput(0)  # "08 - Diâmetro da armadura distribuída ao longo da menor dimençao (mm)"; graph input
n13_colarinho_na_sapata = BoolSelector(true)  # "13 - Colarinho na sapata? (Verdadeiro= detalhar colarinho ou Falso= não detalhar )"; graph input
n14_tamanho_do_colarinho_cm = DoubleInput(2.5)  # "14- Tamanho do Colarinho (cm)"; graph input
n09_resistência_característica_do = DoubleInput(0)  # "09 - Resistência característica do concreto (MPa)"; graph input
n10_coeficiente_de_ponderação_da = DoubleInput(0)  # "10 - Coeficiente de ponderação da resistência do aço (γs)"; graph input
n11_coeficiente_de_ponderação_da = DoubleInput(0)  # "11- Coeficiente de ponderação da resistência do concreto (γc)"; graph input
n17_altura_total_mínima_da_sapata = BoolSelector(false)  # "17 - Altura total mínima da sapata? (Verdadeiro= definir altura mínima ou Falso= não definir)"; graph input
n18_valor_da_altura_mínima_cm = DoubleInput(0)  # "18- Valor da altura mínima (cm)"; graph input
n15_espaçamento_máximo_entre = BoolSelector(false)  # "15 - Espaçamento máximo entre barras? (Verdadeiro= definir espaçamento máximo ou Falso= não definir)"; graph input
n16_valor_do_espaçamento_máximo = DoubleInput(0)  # "16- Valor do espaçamento máximo (cm)"; graph input
n19_altura_h0_mínima_verdadeiro = BoolSelector(false)  # "19 - Altura h0 mínima? (Verdadeiro= definir altura h0 mínima ou Falso= não definir)"; graph input
n20_valor_da_altura_h0_mínima_cm = DoubleInput(0)  # "20- Valor da altura h0 mínima (cm)"; graph input
n01_responsável_pelo_projeto = StringInput("SEU NOME AQUI!")  # "01 - Responsável pelo projeto"; graph input
n02_data = StringInput("Dia/Mês/Ano")  # "02 - Data"; graph input

# group: DIMENSIONAMENTO DA SAPATA
# Descrição <Clique duas vezes aqui para editar a descrição do grupo>
code_block = CodeBlock(Proporção_do_Pilar_ou_Balanços_Iguais=n04_método_de_dimensionamento, Carga_no_Pilar=getParameterValueByName_3, Maior_Dimensão_do_Pilar=getParameterValueByName_4, Menor_Dimensão_do_Pilar=getParameterValueByName_5, Øℓp_Diâmetro_da_Armadura_longitudinal_do_Pilar=getParameterValueByName_6, Tensão_Admissível_do_Solo=n06_tensão_admissível_do_solo_kgf, Cobrimento_Nominal=n05_cobrimento_de_armadura_cm, Øℓ_Diâmetro_da_Armadura_longitudinal=n07_diâmetro_da_armadura, Ødist_Diâmetro_da_Armadura_Distribuída=n08_diâmetro_da_armadura, Colarinho_da_Sapara=n13_colarinho_na_sapata, Dimensão_do_Ccolarinho=n14_tamanho_do_colarinho_cm, FCK_Resistência_Característica_do_Concreto_à_Compressão=n09_resistência_característica_do, coeficiente_de_segurança_do_aço=n10_coeficiente_de_ponderação_da, coeficiente_de_segurança_do_Concreto=n11_coeficiente_de_ponderação_da, altura_mínima=n17_altura_total_mínima_da_sapata, Valor_altura_mínima=n18_valor_da_altura_mínima_cm)
# ---------- code_block.designscript (64 lines) ----------
//VARIÁVEIS PARA O DIMENSIONAMENTO

//MÉTODO DE CÁLCULO
Método = Proporção_do_Pilar_ou_Balanços_Iguais;

//DADOS GEOMÉTRICOS DO ELEMENTO ESTRUTURAL
Nk = Carga_no_Pilar;
a = Maior_Dimensão_do_Pilar;
b = Menor_Dimensão_do_Pilar;
Øℓp = Øℓp_Diâmetro_da_Armadura_longitudinal_do_Pilar;
σadm = Tensão_Admissível_do_Solo;
Cnom = (Cobrimento_Nominal);
Øℓ = Øℓ_Diâmetro_da_Armadura_longitudinal;
Ødist = Ødist_Diâmetro_da_Armadura_Distribuída;
Colarinho = Colarinho_da_Sapara;
Valor_do_colarinho = Dimensão_do_Ccolarinho;
//PROPRIEDADES MECÂNICAS DOS MATERIAIS
FCK = FCK_Resistência_Característica_do_Concreto_à_Compressão;
FYK =Øℓ<6.3?600:500;
ꞃc = coeficiente_de_segurança_do_aço;
γc = coeficiente_de_segurança_do_Concreto;
//DIMENSÕES DA SAPATA
S = (Nk*1.1)/(σadm*0.00980665);

A1 = Método=="True"?0.5*(a-b) + Math.Sqrt(((a-b)*(a-b))/4 + S) : (Math.Sqrt((a/b)*S));

B1 = A1==(0.5*(a-b) + Math.Sqrt(((a-b)*(a-b))/4 + S))? S/A1 : (Math.Sqrt((b/a)*S));
//Altura:
H1 = Math.Max(((A1-a)/3), ((B1-b)/3));

//VERIFICAÇÃO DA ANCORAGEM DA ARMADURA DO PILAR COMARADO A lbmín
fctd = FCK < 50 ? (0.21 * Math.Pow(FCK, 2/3))/γc : (2.12*Math.Log10(1+0.11*FCK))/γc;
Lb=Øℓp<32?(((Øℓp/10)/4)*((FYK/ꞃc)/(2.25*1*1*fctd))):(((Øℓp/10)/4)*((FYK/ꞃc)/(2.25*1*((132-Øℓp)/100)*fctd)));
Lbnec= 0.7*Lb;
H21=Lbnec<(0.3*Lb)?(0.3*Lb):Lbnec;
H22=H21<(10*(Øℓp/10))?(10*(Øℓp/10)):H21;
H23=H22<10?10:H22;
H3=Math.Max(H1, (H23+Cnom+(Øℓ/10)+(Ødist/10)));

//Verificação da diagonal comprimida τSd<=τRd2
τSd = ((γc*Nk)/((2*(a+b))*(H3-Cnom-(Øℓ/2))));
τRd2 = (0.27*(1-(FCK/250))*(FCK/γc));
//verificão τSd<=τRd2 até que a altura da sapata seja aumentada em até 30cm:
/*Caso a verificação τSd<=τRd2, a altura da sapata vai ser aumentada em até 30cm.
Se, ainda assim τSd>τRd2, será emitido um aviso: Na verificação da compressão diagonal
do concreto, a altura calculada da sapata já foi aumentada em 30cm! Algo do projeto
deve ser reavaliado no intuito do dimensionamento do elemento estrutural mais
adequado*/
H4= ((γc*Nk)/((2*(a+b))*(H3-Cnom-(Øℓ/2))))<=(0.27*(1-(FCK/250))*(FCK/γc))?H3:(H3+5);
H5= ((γc*Nk)/((2*(a+b))*(H4-Cnom-(Øℓ/2))))<=(0.27*(1-(FCK/250))*(FCK/γc))?H4:(H4+5);
H6= ((γc*Nk)/((2*(a+b))*(H5-Cnom-(Øℓ/2))))<=(0.27*(1-(FCK/250))*(FCK/γc))?H5:(H5+5);
H7= ((γc*Nk)/((2*(a+b))*(H6-Cnom-(Øℓ/2))))<=(0.27*(1-(FCK/250))*(FCK/γc))?H6:(H6+5);
H8= ((γc*Nk)/((2*(a+b))*(H7-Cnom-(Øℓ/2))))<=(0.27*(1-(FCK/250))*(FCK/γc))?H7:(H7+5);
H9= ((γc*Nk)/((2*(a+b))*(H8-Cnom-(Øℓ/2))))<=(0.27*(1-(FCK/250))*(FCK/γc))?H8:(H8+5);
H10= H9==H3+30?"Na verificação da compressão diagonaldo concreto, a altura
calculada da sapata já foi aumentada em 30cm! Algo do projetodeve ser reavaliado no intuito de um dimensionamento do elemento estrutural mais adequado":"Verificação de ancoragem de armadura do pilar e da compressão diagonal do concreto OK!";
// DIMENSÕES DA SAPATA:
Hmín=altura_mínima;
ValHmín=Valor_altura_mínima;
a1=Colarinho=="True"? a+(2*Valor_do_colarinho) : a;
b1=Colarinho=="True"? b+(2*Valor_do_colarinho) : b;
A = (5 * Math.Ceiling(A1/5))<60?60:(5 * Math.Ceiling(A1/5));
B = (5 * Math.Ceiling(B1/5))<60?60:(5 * Math.Ceiling(B1/5));
H =Hmín=="True"?ValHmín:(5 * Math.Ceiling(H9/5));
# ----------------------------------------
n07_verificações_no = Watch(code_block.H10)  # "07 - VERIFICAÇÕES NO DIMENSIONAMENTO"; graph output

# group: DIMENSIONAMENTO DAS ARMADURAS
# Observação: Esse nó é responsável por realizar o dimensionamento das armaduras da sapata.
code_block_cálculo_das_armaduras = CodeBlock(Carga_no_Pilar=getParameterValueByName_3, Maior_Dimensão_da_Sapata=code_block.A, Menor_Dimensão_da_Sapata=code_block.B, Maior_Dimensão_do_Pilar=getParameterValueByName_4, Menor_Dimensão_do_Pilar=getParameterValueByName_5, ꞃc_coeficiente_de_seg=n10_coeficiente_de_ponderação_da, Altura_da_Sapata=code_block.H, Øℓ_Diâmetro_da_Armadu=n07_diâmetro_da_armadura, Ødist_Diâmetro_da_Arm=n08_diâmetro_da_armadura, Cobrimento_Nominal=n05_cobrimento_de_armadura_cm, Espaçamento_Máximo=n15_espaçamento_máximo_entre, Valor_Espaçamento_Máximo=n16_valor_do_espaçamento_máximo, alturah0_mínima=n19_altura_h0_mínima_verdadeiro, Valor_alturah0_mínima=n20_valor_da_altura_h0_mínima_cm)
# ---------- code_block_cálculo_das_armaduras.designscript (80 lines) ----------
//CÁLCULO DA ARMADURA DA SAPATA:
//Armadura paralela à dimensão A
Nk = Carga_no_Pilar;
A =Maior_Dimensão_da_Sapata;
B = Menor_Dimensão_da_Sapata;
a = Maior_Dimensão_do_Pilar;
b = Menor_Dimensão_do_Pilar;
FYKA = Øℓ<6.3?600:500;
FYKB = Ødist<6.3?600:500;
ꞃc = ꞃc_coeficiente_de_segurança_do_aço;
γfγn = 1.68;
H = Altura_da_Sapata;
Øℓ = Øℓ_Diâmetro_da_Armadura_longitudinal;
Ødist = Ødist_Diâmetro_da_Armadura_Distribuída;
Cnom = (Cobrimento_Nominal);
Emax = Espaçamento_Máximo;
valEmax = Valor_Espaçamento_Máximo;
//Armadura paralela à dimensão A: Área de aço calculada:
AscA = (Nk*γfγn*(A-a))/(0.85*(H-Cnom-((Øℓ/10)/2))*8*((FYKA/10)/ꞃc));
//Área de aço mínima
AsmínA =((2-(H/((A/2)-(a/2))))/1.5)*0.001*B*H;
//Área de aço adotada:
AsA=Math.Max(AscA, AsmínA);
//Quantidade de barras:
nA2 = (Math.Ceiling(AsA/(((Math.PI)*((Øℓ/10)*(Øℓ/10))/4))));
nA1=nA2<2?2:(Math.Ceiling(AsA/(((Math.PI)*((Øℓ/10)*(Øℓ/10))/4))));
///DETALHAMENTO -- Espaçamento:
eA1 = (Math.Floor(((B-(2*Cnom) - 3 * (Øℓ/10))/(nA1-1))*2))/2;
nAe = eA1>valEmax? Math.Ceiling(((B- 2*Cnom - 3 * (Øℓ/10))/valEmax)+1):nA1;
nA = Emax=="True"?nAe:(eA1>30? Math.Ceiling(((B- 2*Cnom - 3 * (Øℓ/10))/30)+1):nA1);
eA = (nA==nA1?eA1:((Math.Floor(((B-(2*Cnom) - 3 * (Øℓ/10))/(nA-1))*2))/2));
//cota horizontal:
ChA = (A-(2*Cnom));
//Cota vertical
Cv1A = Øℓ<6.30?(11.5*(Øℓ/10)):(Øℓ<20?(11.5*(Øℓ/10)):(13*(Øℓ/10)));
CvA = ((Math.Ceiling(Cv1A*2))/2);
ht=(Math.Max(((Math.Ceiling((H/3)*2))/2),20));
h01A = ht<CvA?((CvA)+(2*Cnom)):ht;
//Cota de corte A
reA=Øℓ<6.30?(((5*(Øℓ/10))+(Øℓ/10))/2):(Øℓ<20?(((5*(Øℓ/10))+(Øℓ/10))/2):(((8*(Øℓ/10))+(Øℓ/10))/2));
C1A=((Math.PI)*reA)/2;
C2A=reB+((Ødist/10)/2);
µA=2*((2*C2A)-C1A);
CcA=(Math.Ceiling((ChA+(2*(Cota_vertical_uniforme))-µA)/0.1))*0.1;
CcA1=(Math.Ceiling((ChA+(2*(Cota_vertical_uniforme))-µA)/0.1))*0.1;
// O MESMO PROCESSO PARA B:
//Armadura paralela à dimensão B
//Área de aço calculada:
AscB = (Nk*γfγn*(B-b))/(0.85*(H-Cnom-((Ødist/10)/2))*8*((FYKA/10)/ꞃc));
//Área de aço mínima
AsmínB =((2-(H/((B/2)-(b/2))))/1.5)*0.001*A*H;
//Área de aço adotada:
AsB=Math.Max(AscB, AsmínB);
//Quantidade de barras:
nB2 = Math.Ceiling(AsB/(((Math.PI)*((Ødist/10)*(Ødist/10))/4)));
nB1=nB2<2?2:(Math.Ceiling(AsB/(((Math.PI)*((Øℓ/10)*(Øℓ/10))/4))));
//DETALHAMENTO --- Espaçamento:
eB1 = (Math.Floor(((A-(2*Cnom) - 3 * (Øℓ/10))/(nB1-1))*2))/2;
nBe = eB1>valEmax? Math.Ceiling(((A- 2*Cnom - 3 * (Øℓ/10))/valEmax)+1):nB1;
nB = Emax=="True"?nBe:(eB1>30? Math.Ceiling(((A- 2*Cnom - 3 * (Øℓ/10))/30)+1):nB1);
eB = (nB==nB1?eB1:((Math.Floor(((A-(2*Cnom) - 3 * (Øℓ/10))/(nB-1))*2))/2));
//cota horizontal
ChB = B-(2*Cnom);
//Cota vertical
Cv1B = Øℓ<6.30?(11.5*(Ødist/10)):(Ødist<20?(11.5*(Ødist/10)):(13*(Ødist/10)));
CvB = (Math.Ceiling(Cv1B*2))/2;
h01B = ht<CvB?((CvB)+(2*Cnom)):ht;
//Cota de corte B
reB=Ødist<6.30?(((5*(Ødist/10))+(Ødist/10))/2):(Ødist<20?(((5*(Ødist/10))+(Ødist/10))/2):(((8*(Ødist/10))+(Ødist/10))/2));
C1B=((Math.PI)*reB)/2;
C2B=reB+((Ødist/10)/2);
µB=2*((2*C2B)-C1B);
CcB=(Math.Ceiling((ChB+(2*(Cota_vertical_uniforme))-µB)/0.1))*0.1;
CcB1=(Math.Ceiling((ChB+(2*(Cota_vertical_uniforme))-µB)/0.1))*0.1;
Cota_vertical_uniforme = Math.Max(CvA, CvB);
//Cálculo de h0:
h0cal=(5 * Math.Ceiling((Math.Max(h01A, h01B))/5));
h0 =H0mín=="True"?ValH0mín:h0cal;
H0mín=alturah0_mínima;
ValH0mín=Valor_alturah0_mínima;
# ----------------------------------------

# group: RENOMEAR A SAPATA DE ACORDO COM O NOME PILAR
# Observação: a sapata locada terá o some com prefixo "SAPATA DE" e sufixo igual ao identificador do pilar, especificado como marca. Dessa forma é importante inserir o parâmetro marca do pilar para nomear a sapata automaticamente.
string_10 = StringInput("S")
string_11 = StringInput("Marca")
getParameterValueByName_7 = Element.GetParameterValueByName(element=n12_selecione_o_pilar_que_deseja, parameterName=string_11)
concat_2 = String.Concat(string0=string_10, string1=getParameterValueByName_7)

# group: INSERÇÃO DE PARÂMETROS DE DIMENSÕES DO ELEMENTO ESTRUTURAL
# Descrição <Clique duas vezes aqui para editar a descrição do grupo>
string_12 = StringInput("h1")
setParameterByName_2 = Element.SetParameterByName(element=n01_elemento_estrutural, parameterName=string_12, value=code_block_cálculo_das_armaduras.h0)
string_13 = StringInput("Largura")
setParameterByName_3 = Element.SetParameterByName(element=n01_elemento_estrutural, parameterName=string_13, value=code_block.B)
string_14 = StringInput("a")
setParameterByName_4 = Element.SetParameterByName(element=n01_elemento_estrutural, parameterName=string_14, value=code_block.a1)
string_15 = StringInput("Comprimento")
setParameterByName_5 = Element.SetParameterByName(element=n01_elemento_estrutural, parameterName=string_15, value=code_block.A)
string_16 = StringInput("H")
setParameterByName_6 = Element.SetParameterByName(element=n01_elemento_estrutural, parameterName=string_16, value=code_block.H)
string_17 = StringInput("b")
setParameterByName_7 = Element.SetParameterByName(element=n01_elemento_estrutural, parameterName=string_17, value=code_block.b1)
string_18 = StringInput("Marca")
setParameterByName_8 = Element.SetParameterByName(element=setParameterByName, parameterName=string_18, value=concat_2)
string_19 = StringInput("MAIOR DIMENSÃO a")
setParameterByName_9 = Element.SetParameterByName(element=n01_elemento_estrutural, parameterName=string_19, value=code_block.a1)
string_20 = StringInput("MENOR DIMENSÃO b")
setParameterByName_10 = Element.SetParameterByName(element=n01_elemento_estrutural, parameterName=string_20, value=code_block.b1)

geometry = Element.Geometry(element=setRotation)

# group: CRIAÇÃO DE VISTA DE CORTE RENOMEADA, COM ESTILO DE VISTA E ESCALA
# Descrição <Clique duas vezes aqui para editar a descrição do grupo>
firstItem = List.FirstItem(list=geometry)
byMinimumVolume = BoundingBox.ByMinimumVolume(geom=firstItem)
toCuboid = BoundingBox.ToCuboid(boundingBox=byMinimumVolume)
explode = Geometry.Explode(geometry=toCuboid)
surface_filterorientation = Custom[👓 Surface․FilterOrientation](surfaces=explode)  # package BIMCoder Nodes - 2.X; Separa as superfícies em 3 listas distintas: Superfícies topo (UpSurface), superfícies base (DownSurface) e superfícies laterais (LateralSurface).
number = DoubleInput(0.5)
pointAtParameter = Surface.PointAtParameter(surface=surface_filterorientation.downSurfaces, u=number, v=number)
number_2 = DoubleInput(0.5)
getIsoline = Surface.GetIsoline(surface=surface_filterorientation.downSurfaces, parameter=number_2)
startPoint = Curve.StartPoint(curve=getIsoline)
endPoint = Curve.EndPoint(curve=getIsoline)
byStartPointEndPoint = Line.ByStartPointEndPoint(startPoint=startPoint, endPoint=endPoint)
direction = Line.Direction(line=byStartPointEndPoint)
reverse = Vector.Reverse(vector=direction)
ZAxis = Vector.ZAxis()
cross = Vector.Cross(vector=direction, cross=ZAxis)
byOriginVectors = CoordinateSystem.ByOriginVectors(origin=pointAtParameter@L2, xAxis=reverse, yAxis=ZAxis, zAxis=cross)
flatten = List.Flatten(list=byOriginVectors@L3)
firstItem_2 = List.FirstItem(list=flatten)
length = Curve.Length(curve=getIsoline)
number_3 = DoubleInput(1)
getIsoline_2 = Surface.GetIsoline(surface=surface_filterorientation.downSurfaces, isoDirection=number_3, parameter=number_2)
length_2 = Curve.Length(curve=getIsoline_2)
code_block_2 = CodeBlock(C1=length, C2=length_2)
# ---------- code_block_2.designscript (7 lines) ----------
//Ponto mínimo:
CURVA1=C1;
CURVA2=C2;
comprimento=Math.Max(C1,C2);
Largura_esquerda = (-comprimento/2)-40;
Altura_negativa=-45;
ofset_do_corte = 0;
# ----------------------------------------
byCoordinates_2 = Point.ByCoordinates(x=code_block_2.Largura_esquerda, y=code_block_2.Altura_negativa, z=code_block_2.ofset_do_corte)
length_3 = Curve.Length(curve=getIsoline)
length_4 = Curve.Length(curve=getIsoline_2)
code_block_3 = CodeBlock(C1=length_3, C2=length_4, Altura_da_sapata=code_block.H, maior_lado_da_sapata=code_block.A)
# ---------- code_block_3.designscript (7 lines) ----------
//Ponto máximo:
CURVA1=C1;
CURVA2=C2;
comprimento=Math.Max(C1, C2);
Largura_direita = (comprimento/2)+40;
Altura_Positiva=Altura_da_sapata+45;
Profundidade_do_corte = maior_lado_da_sapata;
# ----------------------------------------
byCoordinates_3 = Point.ByCoordinates(x=code_block_3.Largura_direita, y=code_block_3.Altura_Positiva, z=code_block_3.Profundidade_do_corte)
n04_vista_de_corte_criada_ok = SectionView.ByCoordinateSystemMinPointMaxPoint(cs=firstItem_2@L2, minPoint=byCoordinates_2, maxPoint=byCoordinates_3)  # "04 - VISTA DE CORTE CRIADA: OK!"
firstItem_3 = List.FirstItem(list=n04_vista_de_corte_criada_ok)
code_block_4 = CodeBlock(nome=concat_2) { PREFIXO = "Corte AA Sapata "; NOMEe = PREFIXO + nome; }
string_21 = StringInput("Corte AA Sapata")
setName = Custom[Element.SetName](element=firstItem_3@L2, name=code_block_4.NOMEe, replacementForIllegalChars=string_21)  # package Clockwork for Dynamo 2.x; Gets the name of a given Revit element
string_22 = StringInput("ShadingWithEdges")
setDisplayStyle = View.SetDisplayStyle(view=n04_vista_de_corte_criada_ok, displayStyle=string_22)
number_4 = DoubleInput(25)
setScale = View.SetScale(view=n04_vista_de_corte_criada_ok, scale=number_4)
n04_vista_de_corte_criada_ok_2 = Watch(n04_vista_de_corte_criada_ok)  # "04 - VISTA DE CORTE CRIADA: OK!"; graph output

# group: CRIAÇÃO DE VISTA DE PLANTA RENOMEADA, COM ESTILO DE VISTA E ESCALA
# TAMBÉM APLICA ESTILO DE VISTA E ESCALA NA VISTA ATUAL
current = Document.Current()
activeView = Document.ActiveView(document=current)
string_23 = StringInput("V1")
n0101 = Custom[0101](view=activeView, name=string_23)  # package Clockwork for Dynamo 2.x; Duplicates a given view
firstItem_4 = List.FirstItem(list=n0101)
firstItem_5 = List.FirstItem(list=geometry)
byMinimumVolume_2 = BoundingBox.ByMinimumVolume(geom=firstItem_5)
minPoint = BoundingBox.MinPoint(boundingBox=byMinimumVolume_2)
maxPoint = BoundingBox.MaxPoint(boundingBox=byMinimumVolume_2)
code_block_5 = CodeBlock(ponto_mínimo_da_BoundingBox=minPoint, ponto_Maximo_da_BoundingBox=maxPoint)
# ---------- code_block_5.designscript (24 lines) ----------
// Entradas:
p_min = ponto_mínimo_da_BoundingBox;
 // MinPoint (Saída do Nó A);
p_max = ponto_Maximo_da_BoundingBox;
 // MaxPoint (Saída do Nó B);
margem1 = 60;

 // 0.4 metros = 40 cm de margem;

// 1. PONTO MÍNIMO (Subtrai a margem)
// Xmin - margem, Ymin - margem, Zmin - margem
novo_min_x = p_min.X - margem1;
novo_min_y = p_min.Y - margem1;
novo_min_z = p_min.Z - margem1;

// 2. PONTO MÁXIMO (Adiciona a margem)
// Xmax + margem, Ymax + margem, Zmax + margem
novo_max_x = p_max.X + margem1;
novo_max_y = p_max.Y + margem1;
novo_max_z = p_max.Z + margem1;

// 3. RECRIAR OS PONTOS
novo_min = Point.ByCoordinates(novo_min_x, novo_min_y, novo_min_z);
novo_max = Point.ByCoordinates(novo_max_x, novo_max_y, novo_max_z);
# ----------------------------------------
byCorners = BoundingBox.ByCorners(min=code_block_5.novo_min, max=code_block_5.novo_max)
n03_planta_de_piso_criada_ok = View.SetCropBox(view=firstItem_4, boundingBox=byCorners)  # "03 - PLANTA DE PISO CRIADA: OK!"
code_block_6 = CodeBlock(nome=concat_2) { PREFIXO = "Detalhe Sapata "; NOMEe = PREFIXO + nome; }
string_24 = StringInput("Detalhe Sapata")
setName_2 = Custom[Element.SetName](element=n03_planta_de_piso_criada_ok, name=code_block_6.NOMEe, replacementForIllegalChars=string_24)
string_25 = StringInput("ShadingWithEdges")
setDisplayStyle_2 = View.SetDisplayStyle(view=n0101, displayStyle=string_25)
number_5 = DoubleInput(25)
setScale_2 = View.SetScale(view=n0101, scale=number_5)
n03_planta_de_piso_criada_ok_2 = Watch(n03_planta_de_piso_criada_ok)  # "03 - PLANTA DE PISO CRIADA: OK!"; graph output
number_6 = DoubleInput(25)
setScale_3 = View.SetScale(view=activeView, scale=number_6)
string_26 = StringInput("ShadingWithEdges")
setDisplayStyle_3 = View.SetDisplayStyle(view=activeView, displayStyle=string_26)

# group: INSERE A TEG DA SAPATA NA VISTA ATUAL
# Descrição <Clique duas vezes aqui para editar a descrição do grupo>
firstItem_6 = List.FirstItem(list=setParameterByName)
firstItem_7 = List.FirstItem(list=setRotation)
firstItem_8 = List.FirstItem(list=firstItem_7)
getLocation = Element.GetLocation(element=firstItem_8)
facingOrientation = FamilyInstance.FacingOrientation(familyInstance=firstItem_8)
number_7 = DoubleInput(-40)
translate = Geometry.Translate(geometry=getLocation, direction=facingOrientation, distance=number_7)
family_types = FamilyTypes("01- Identificador_sapata e dimensões:01- Identificador_sapata e dimensões")
tag_byelement = Custom[👓 Tag․ByElement](element=firstItem_6, TagLocation=translate, TagType=family_types)  # package BIMCoder Nodes - 2.X; Cria uma Tag em elemento(s) dado o tipo da Tag e a posição

# group: CRIAÇÃO DE VISTA 3D RENOMEADA, COM ESTILO DE VISTA E ESCALA
# Descrição <Clique duas vezes aqui para editar a descrição do grupo>
code_block_7 = CodeBlock(nome=concat_2) { PREFIXO = "3D Sapata "; NOMEe = PREFIXO + nome; }
string_27 = StringInput("Vista 3D")
viewtype_byname = Custom[👓 ViewType․ByName](viewTypeName=string_27)  # package BIMCoder Nodes - 2.X; Obtém um ViewType a partir do nome
firstItem_9 = List.FirstItem(list=viewtype_byname)
boundingBox = Geometry.BoundingBox(geometry=geometry)
minPoint_2 = BoundingBox.MinPoint(boundingBox=boundingBox)
maxPoint_2 = BoundingBox.MaxPoint(boundingBox=boundingBox)
code_block_8 = CodeBlock(ponto_mínimo_da_BoundingBox=minPoint_2, ponto_Maximo_da_BoundingBox=maxPoint_2, H=code_block.H)
# ---------- code_block_8.designscript (25 lines) ----------
// Entradas:
p_min = ponto_mínimo_da_BoundingBox;
 // MinPoint (Saída do Nó A);
p_max = ponto_Maximo_da_BoundingBox;
 // MaxPoint (Saída do Nó B);
margem1 = 15;
margem2 =H+10;

 // 0.5 metros = 50 cm de margem;

// 1. PONTO MÍNIMO (Subtrai a margem)
// Xmin - margem, Ymin - margem, Zmin - margem
novo_min_x = p_min.X - margem1;
novo_min_y = p_min.Y - margem1;
novo_min_z = p_min.Z - margem2;

// 2. PONTO MÁXIMO (Adiciona a margem)
// Xmax + margem, Ymax + margem, Zmax + margem
novo_max_x = p_max.X + margem1;
novo_max_y = p_max.Y + margem1;
novo_max_z = p_max.Z + margem2;

// 3. RECRIAR OS PONTOS
novo_min = Point.ByCoordinates(novo_min_x, novo_min_y, novo_min_z);
novo_max = Point.ByCoordinates(novo_max_x, novo_max_y, novo_max_z);
# ----------------------------------------
byCorners_2 = BoundingBox.ByCorners(min=code_block_8.novo_min, max=code_block_8.novo_max)
firstItem_10 = List.FirstItem(list=byCorners_2)
byTypeBoundingBox = Custom[View3D.byTypeBoundingBox](viewName=code_block_7.NOMEe, viewType=firstItem_9, bb=firstItem_10@L1)  # package BIMCoder Nodes - 2.X; Cria uma vista 3D (isométrica) a partir do nome, tipo da vista e BoundingBox
number_8 = DoubleInput(25)
setScale_4 = View.SetScale(view=byTypeBoundingBox.view3D, scale=number_8)
string_28 = StringInput("ShadingWithEdges")
n05_vista_3d_criada_ok = View.SetDisplayStyle(view=byTypeBoundingBox.view3D, displayStyle=string_28)  # "05 - VISTA 3D CRIADA: OK!"
n05_vista_3d_criada_ok_2 = Watch(n05_vista_3d_criada_ok)  # "05 - VISTA 3D CRIADA: OK!"; graph output

# group: CÁLCULO DO PESO DO AÇO NO ELEMENTO ESTRUTURAL ESTUDADO
# Descrição <Clique duas vezes aqui para editar a descrição do grupo>
code_block_9 = CodeBlock()
# ---------- code_block_9.designscript (5 lines) ----------
// LISTA DE PESOS LINEARES (em kg/m) - Ordem: 4.2, 5, 6.3, 8, 10, 12.5, 16, 20, 25, 32
pesos = [0.109, 0.154,0.154, 0.245, 0.395,0.395, 0.617,0.617, 0.963, 1.578,1.578, 2.466, 2.466, 3.853,3.853, 6.313,6.313];

// LISTA DE BITOLAS (para referência/busca)
bitolas = [4.2,5, 5.0, 6.3, 8,8.8, 10.0,10, 12.5, 16.0,16, 20.0,20, 25.0,25, 32.0,32];
# ----------------------------------------
indexOf = List.IndexOf(list=code_block_9.bitolas, element=n07_diâmetro_da_armadura)
getItemAtIndex = List.GetItemAtIndex(list=code_block_9.pesos, index=indexOf)
indexOf_2 = List.IndexOf(list=code_block_9.bitolas, element=n08_diâmetro_da_armadura)
getItemAtIndex_2 = List.GetItemAtIndex(list=code_block_9.pesos, index=indexOf_2)
code_block_10 = CodeBlock(nA=code_block_cálculo_das_armaduras.nA, CcA=code_block_cálculo_das_armaduras.CcA, APeso_linear=getItemAtIndex, nB=code_block_cálculo_das_armaduras.nB, CcB=code_block_cálculo_das_armaduras.CcB, BPeso_linear=getItemAtIndex_2)
# ---------- code_block_10.designscript (4 lines) ----------
//Cálculo do peso total de aço para a sa´pata analisada.
Peso_Øℓ=nA*(CcA/100)*APeso_linear;
Peso_Ødist=nB*(CcB/100)*BPeso_linear;
PESO_TOTAL_DE_AÇO =Peso_Ødist+Peso_Øℓ;
# ----------------------------------------

# group: DESCRIÇÃO DE ARMAÇÃO EM CADA DIREÇÃO
# Descrição <Clique duas vezes aqui para editar a descrição do grupo>
code_block_11 = CodeBlock(NbA=code_block_cálculo_das_armaduras.nA, Øℓ=code_block_cálculo_das_armaduras.Øℓ, eA=code_block_cálculo_das_armaduras.eA, CHA=code_block_cálculo_das_armaduras.ChA, CVA=code_block_cálculo_das_armaduras.Cota_vertical_uniforme, CcA=code_block_cálculo_das_armaduras.CcA, NbB=code_block_cálculo_das_armaduras.nB, Ødist=code_block_cálculo_das_armaduras.Ødist, eB=code_block_cálculo_das_armaduras.eB, CHB=code_block_cálculo_das_armaduras.ChB, CVB=code_block_cálculo_das_armaduras.Cota_vertical_uniforme, CcB=code_block_cálculo_das_armaduras.CcB)
# ---------- code_block_11.designscript (16 lines) ----------
//CÓDIGO PARA GERAR DESCRIÇÃO DE ARMAÇÃO EM CADA DIREÇÃO:
A_NÚMERO_DE_BARRAS=NbA;
A_BITOLA=Øℓ;
A_ESPAÇAMENTO=eA;
A_COMPRIMENTO_HORIZONTAL=CHA;
A_COMPRIMENTO_VERTICAL=CVA;
A_COMPRIMENTO_DE_CORTE=CcA;
B_NÚMERO_DE_BARRAS=NbB;
B_BITOLA=Ødist;
B_ESPAÇAMENTO=eB;
B_COMPRIMENTO_HORIZONTAL=CHB;
B_COMPRIMENTO_VERTICAL=CVB;
B_COMPRIMENTO_DE_CORTE=CcB;

ARMAÇÃO_EM_A=NbA+" Ø"+Øℓ+"c/ "+eA+" CH= "+CHA+" CV = "+CVA+" C = "+CcA;
ARMAÇÃO_EM_B=NbB+" Ø"+Ødist+"c/ "+eB+" CH= "+CHB+" CV = "+CVB+" C = "+CcB;
# ----------------------------------------
string_from_object = FromObject(object=[code_block_11.ARMAÇÃO_EM_B, code_block_11.ARMAÇÃO_EM_B])
watch = Watch(string_from_object)
string_from_object_2 = FromObject(object=[code_block_11.ARMAÇÃO_EM_A, code_block_11.ARMAÇÃO_EM_A])
watch_2 = Watch(string_from_object_2)

# group: CALCULAR VOLUME DE CONCRETO DO ELEMENTO ESTRUTURAL ESTUDADO
# Descrição <Clique duas vezes aqui para editar a descrição do grupo>
code_block_12 = CodeBlock(Maior_Dimensão_da_Sapata=code_block.A, Menor_Dimensão_da_Sapata=code_block.B, Maior_Dimensão_do_Pilar=code_block.a1, Menor_Dimensão_do_Pilar=code_block.b1, Altura_da_Sapata=code_block.H, h1=code_block_cálculo_das_armaduras.h0)
# ---------- code_block_12.designscript (9 lines) ----------
//CÓDIGO PARA CALCULAR VOLUME DE CONCRETO DO ELEMENTO ESTRUTURAL ESTUDADO:
A = (Maior_Dimensão_da_Sapata)/100;
B = (Menor_Dimensão_da_Sapata)/100;
a = (Maior_Dimensão_do_Pilar)/100;
b = (Menor_Dimensão_do_Pilar)/100;
H = (Altura_da_Sapata)/100;
h0 = (h1)/100;
//Volume total:
V=((H-h0)/3)*((A*B)+(a*b)+(Math.Sqrt(A*B*a*b)))+(A*B*h0);
# ----------------------------------------

# group: Título <Clique duas vezes aqui para editar o título do grupo>
# Descrição <Clique duas vezes aqui para editar a descrição do grupo>
string_29 = StringInput("A - BITOLA")
setParameterByName_11 = Element.SetParameterByName(element=n01_elemento_estrutural, parameterName=string_29, value=code_block_cálculo_das_armaduras.Øℓ)
string_30 = StringInput("A - NÚMERO DE BARRAS")
setParameterByName_12 = Element.SetParameterByName(element=n01_elemento_estrutural, parameterName=string_30, value=code_block_cálculo_das_armaduras.nA)
string_31 = StringInput("A - COMPRIMENTO HORIZONTAL")
setParameterByName_13 = Element.SetParameterByName(element=n01_elemento_estrutural, parameterName=string_31, value=code_block_cálculo_das_armaduras.ChA)
string_32 = StringInput("A - ESPAÇAMENTO")
setParameterByName_14 = Element.SetParameterByName(element=n01_elemento_estrutural, parameterName=string_32, value=code_block_cálculo_das_armaduras.eA)
string_33 = StringInput("A - COMPRIMENTO DE CORTE")
setParameterByName_15 = Element.SetParameterByName(element=n01_elemento_estrutural, parameterName=string_33, value=code_block_cálculo_das_armaduras.CcA)
string_34 = StringInput("A - COMPRIMENTO VERTICAL")
setParameterByName_16 = Element.SetParameterByName(element=n01_elemento_estrutural, parameterName=string_34, value=code_block_cálculo_das_armaduras.Cota_vertical_uniforme)
string_35 = StringInput("B - COMPRIMENTO DE CORTE")
setParameterByName_17 = Element.SetParameterByName(element=n01_elemento_estrutural, parameterName=string_35, value=code_block_cálculo_das_armaduras.CcB)
string_36 = StringInput("B - COMPRIMENTO VERTICAL")
setParameterByName_18 = Element.SetParameterByName(element=n01_elemento_estrutural, parameterName=string_36, value=code_block_cálculo_das_armaduras.Cota_vertical_uniforme)
string_37 = StringInput("B - COMPRIMENTO HORIZONTAL")
setParameterByName_19 = Element.SetParameterByName(element=n01_elemento_estrutural, parameterName=string_37, value=code_block_cálculo_das_armaduras.ChB)
string_38 = StringInput("B - ESPAÇAMENTO")
setParameterByName_20 = Element.SetParameterByName(element=n01_elemento_estrutural, parameterName=string_38, value=code_block_cálculo_das_armaduras.eB)
string_39 = StringInput("B - BITOLA")
setParameterByName_21 = Element.SetParameterByName(element=n01_elemento_estrutural, parameterName=string_39, value=code_block_cálculo_das_armaduras.Ødist)
string_40 = StringInput("B - NÚMERO DE BARRAS")
setParameterByName_22 = Element.SetParameterByName(element=n01_elemento_estrutural, parameterName=string_40, value=code_block_cálculo_das_armaduras.nB)
string_41 = StringInput("ALTURA H")
setParameterByName_23 = Element.SetParameterByName(element=n01_elemento_estrutural, parameterName=string_41, value=code_block.H)
string_42 = StringInput("h0")
setParameterByName_24 = Element.SetParameterByName(element=n01_elemento_estrutural, parameterName=string_42, value=code_block_cálculo_das_armaduras.h0)
string_43 = StringInput("Peso total de aço no elemento (kg)")
setParameterByName_25 = Element.SetParameterByName(element=n01_elemento_estrutural, parameterName=string_43, value=code_block_10.PESO_TOTAL_DE_AÇO)
string_44 = StringInput("ARMAÇÃO NA MAIOR DIMENSÃO (A)")
setParameterByName_26 = Element.SetParameterByName(element=n01_elemento_estrutural, parameterName=string_44, value=watch)
string_45 = StringInput("ARMAÇÃO NA MENOR DIMENSÃO (B)")
setParameterByName_27 = Element.SetParameterByName(element=n01_elemento_estrutural, parameterName=string_45, value=watch_2)
string_46 = StringInput("Volume de concreto do elemento (m³)")
setParameterByName_28 = Element.SetParameterByName(element=n01_elemento_estrutural, parameterName=string_46, value=code_block_12.V)

# group: CRIA TABELA DE QUANTITATIVOS NO PROJETO
# Descrição <Clique duas vezes aqui para editar a descrição do grupo>
categories = Categories("OST_StructuralFoundation")
string_47 = StringInput("TABELA RESUMO - FUNDAÇÕES TIPO SAPATA ISOLADA")
schedule_type = ScheduleTypes("RegularSchedule")
categories_2 = Categories("OST_Schedules")
all_elements_of_category = ElementsOfCategory(Category=categories_2)
name = Element.Name(element=all_elements_of_category)
string_48 = StringInput("TABELA RESUMO - FUNDAÇÕES TIPO SAPATA ISOLADA")
contains = List.Contains(list=name, item=string_48)
filterByBoolMask = List.FilterByBoolMask(list=all_elements_of_category, mask=contains)
flatten_2 = List.Flatten(list=filterByBoolMask.in)
delete = Element.Delete(element=flatten_2@L2)
passthrough = Custom[Passthrough](passThrough=schedule_type, waitFor=delete)  # package Clockwork for Dynamo 2.x; Forces a sequential order of execution. The node wired into the output of the Passthrough node will be executed *after* the node wired into the waitFor input (e.g. important for some Revit operations). The value of the passThrough input will be passed on to the node wired into the output port of the Passthrough node.
n06_tabela_de_quantitativo_de = ScheduleView.CreateSchedule(category=categories, name=string_47, scheduleType=passthrough)  # "06 - TABELA DE QUANTITATIVO DE MATERIAIS CRIADA: OK!"
schedulableFields = ScheduleView.SchedulableFields(scheduleView=n06_tabela_de_quantitativo_de)
string_from_object_3 = FromObject(object=schedulableFields)
code_block_13 = CodeBlock { Lista_de_parâmetros_de_tabela = ["Marca","Largura","Comprimento","MAIOR DIMENSÃO a","MENOR DIMENSÃO b","ALTURA H","h0","Volume de concreto do elemento (m³)", "ARMAÇÃO NA MAIOR DIMENSÃO (A)","ARMAÇÃO NA MENOR DIMENSÃO (B)","Peso total de aço no elemento (kg)"]; }
indexOf_3 = List.IndexOf(list=string_from_object_3, element=code_block_13)
getItemAtIndex_3 = List.GetItemAtIndex(list=schedulableFields, index=indexOf_3)
addFields = ScheduleView.AddFields(scheduleView=n06_tabela_de_quantitativo_de, fields=getItemAtIndex_3)
n06_tabela_de_quantitativo_de_2 = Watch(n06_tabela_de_quantitativo_de)  # "06 - TABELA DE QUANTITATIVO DE MATERIAIS CRIADA: OK!"; graph output

# group: CRIAÇÃO DE VISTA DE PLANTA RENOMEADA, COM ESTILO DE VISTA E ESCALA > INSERE A TEG DA SAPATA NA VISTA ATUAL
# Descrição <Clique duas vezes aqui para editar a descrição do grupo>
firstItem_11 = List.FirstItem(list=setParameterByName)
firstItem_12 = List.FirstItem(list=setRotation)
firstItem_13 = List.FirstItem(list=firstItem_12)
getLocation_2 = Element.GetLocation(element=firstItem_13)
facingOrientation_2 = FamilyInstance.FacingOrientation(familyInstance=firstItem_13)
number_9 = DoubleInput(-40)
translate_2 = Geometry.Translate(geometry=getLocation_2, direction=facingOrientation_2, distance=number_9)
family_types_2 = FamilyTypes("01- Identificador_sapata e dimensões:01- Identificador_sapata e dimensões")
tag_byelement_2 = Custom[👓 Tag․ByElement](view=firstItem_4, element=firstItem_11, TagLocation=translate_2, TagType=family_types_2)

# group: RELATÓRIO DE CALCULO DO ELEMETO ESTRUTURAL
# Observação: o relatório é específico para o pilar analisado .
code_block_14 = CodeBlock(nome=concat_2) { PREFIXO = "MEMORIAL DE CÁLCULO "; NOMEe = PREFIXO + nome; }
n03_escolha_uma_pasta_para_salvar = Directory("Nenhum arquivo selecionado.")  # "03- ESCOLHA UMA PASTA PARA SALVAR O(S) RELATÓRIO(S) DE CÁCULO"; graph input
code_block_15 = CodeBlock(NOME=code_block_14.NOMEe, PASTA=n03_escolha_uma_pasta_para_salvar) { NOME; PASTA; ARQUIVO=PASTA+"\\"+NOME+".txt"; }
code_block_16 = CodeBlock { "\n"; }
code_block_17 = CodeBlock(Responsável=n01_responsável_pelo_projeto, Dia=n02_data, nome_do_pilar=getParameterValueByName_2, Nk=getParameterValueByName_3, menor_dimensão=getParameterValueByName_5, maior_dimensão=getParameterValueByName_4, σadm=n06_tensão_admissível_do_solo_kgf, Cnom=n05_cobrimento_de_armadura_cm, Øℓ=n07_diâmetro_da_armadura, Ødist=n08_diâmetro_da_armadura, hmin=n17_altura_total_mínima_da_sapata, Hmínadot=n18_valor_da_altura_mínima_cm, h0min=n19_altura_h0_mínima_verdadeiro, H0mínadot=n20_valor_da_altura_h0_mínima_cm, Øℓp=getParameterValueByName_6, fck=n09_resistência_característica_do, γc=n11_coeficiente_de_ponderação_da, ꞃc=n10_coeficiente_de_ponderação_da, S_área_da_base=code_block.S, A1=code_block.A1, B1=code_block.B1, H_normal=code_block.H1, ℓb_nec=code_block.Lbnec, H_com_ℓb=code_block.H3, τSd=code_block.τSd, τRd2=code_block.τRd2, verificação_biela=n07_verificações_no, cota_Verificação_da_d=code_block.H9, H1=code_block.H9, a=getParameterValueByName_4, acalculado=code_block.a1, colarinho=n14_tamanho_do_colarinho_cm, b=getParameterValueByName_5, bcalculado=code_block.b1, aviso_sobre_verificaç=n07_verificações_no, Proporção_do_Pilar_ou=n04_método_de_dimensionamento, AscA1=code_block_cálculo_das_armaduras.AscA, AsmínA=code_block_cálculo_das_armaduras.AsmínA, ncA=code_block_cálculo_das_armaduras.nA1, ecA=code_block_cálculo_das_armaduras.eA, EAadot=n16_valor_do_espaçamento_máximo, nA=code_block_cálculo_das_armaduras.nA, EAfinal=code_block_cálculo_das_armaduras.eA, EA=n15_espaçamento_máximo_entre, CHA=code_block_cálculo_das_armaduras.ChA, CVA=code_block_cálculo_das_armaduras.Cv1A, CA=code_block_cálculo_das_armaduras.CcA1, AscB1=code_block_cálculo_das_armaduras.AscB, AsmínB=code_block_cálculo_das_armaduras.AsmínB, ncB=code_block_cálculo_das_armaduras.nB1, ecB=code_block_cálculo_das_armaduras.eB, EBadot=n16_valor_do_espaçamento_máximo, nB=code_block_cálculo_das_armaduras.nB, EBfinal=code_block_cálculo_das_armaduras.eB, EB=n15_espaçamento_máximo_entre, CHB=code_block_cálculo_das_armaduras.ChB, CVB=code_block_cálculo_das_armaduras.Cv1B, CB=code_block_cálculo_das_armaduras.CcB1, CV=code_block_cálculo_das_armaduras.Cota_vertical_uniforme, h0=code_block_cálculo_das_armaduras.h0cal, A=code_block.A, B=code_block.B, H=code_block.H, H0F=code_block_cálculo_das_armaduras.h0, armadura_a=watch, armadura_b=watch_2, Vconcreto=code_block_12.V, Paço=code_block_10.PESO_TOTAL_DE_AÇO)
# ---------- code_block_17.designscript (127 lines) ----------
linha1="                              ABNT NBR 6118 (2023)";
linha2="                  Dimensionamento à flexocompressão de sapata isolada";
linha3="Projeto: Projeto estrutural de fundação";
linha4="Elemento estrutural: Sapata isolada";
linha5= "Responsável: " + Responsável;
linha6="Data: " + Dia;
linha7="
DADOS GEOMÉTRICOS DO ELEMENTO ESTRUTURAL";
pilar = "Pilar estrutural: "+nome_do_pilar;
linha8="1.1 Carga concentrada no pilar (Nk): " + Nk + " kN";
linha9="1.2 Dimensões do pilar (a x b): " + menor_dimensão + " x " + maior_dimensão  + " cm";
linha10="1.3 Tensão admissível do solo (σadm): " +σadm + "Kgf/cm²";
linha11= "1.4 Sapata: ";
linha12= "1.4.1 Cobrimento nominal (Cnom): "+Cnom+ "cm";
linha13= "1.4.2 Diâmetro da armadura distribuída ao longo da maior dimenção: "+Øℓ+ "mm";
linha14= "1.4.3 Diâmetro da armadura distribuída ao longo da menor dimenção (mm): "+Ødist+ "mm";
linha15= "1.5 Dimensões mínimas adotadas ";
adotadoH = hmin=="True"?("h mínimo adotado= "+ Hmínadot+ " cm"):("Não especificado.");
adotadoH0 = h0min=="True"?("h0 mínimo adotado= "+ H0mínadot+ " cm"):("Não especificado.");
linha17= "Diâmetro da armadura longitudinal do pilar (Øℓp): "+Øℓp+ "mm";
linha18="
PROPRIEDADES MECÂNICAS DOS MATERIAIS";
linha19= "2.1 Concreto: ";
linha20="2.1.1 Resistência Característica do Concreto à Compressão (fck): " + fck + " Mpa";
linha21="2.1.2 Coeficiente de ponderação da resistência do concreto (γc)= "+γc;
linha22="2.1.3 Resistência Característica do Concreto à Compressão de cálculo (fcd): " + (fck/γc) + " Mpa";
linha23= "2.2 Aço: ";
ꞃc1 = "2.2.1 Coeficiente de ponderação da resistência do aço (γs)="+ꞃc;
linha24= "2.2.2 Tensão de escoamento do aço (fyk): de acordo com o diâmetro da barra, podendo assumir valores de 600 Mpa para barras com diâmetro menor que 6.3mm e 500 Mpa para as demais.";

linha25="
DIMENSÕES DA SAPATA";
Arredondamento = "Nota: Todos os valores foram arredondados para múltiplos de 0,5cm no intuito de facilitar o processo executivo";

linha26= "3.1 Método de cálculo: "+ Método;
linha27= "3.1.1 Dimensões da base: ";
linha28= "3.1.2 Área da base: Pela Equação 3 S= "+ S_área_da_base+ " cm²";
linha29= "3.1.3 Dimensão A (paralela a maior dimensão do pilar) é:
A= "+ Calculo_de_A+A1+ " cm";
linha30= "3.1.4 Dimensão B (paralela a menor dimensão do pilar) é:
B= "+ Calculo_de_B+B1+ " cm";
linha31= "3.1.5 Altura total da sapata:
Pela Equação 01, H= "+H_normal+" cm";
linha32= "3.1.5.1 Verificação da ancoragem da armadura do pilar: ";
linha33= "Determinando primeiro ℓb,nec pela Equação 08, ℓb,nec= "+ℓb_nec+" cm";
linha34= "Desse modo, comparando a altura calculada da sapata (Equação 1) com ℓb,nec+Cnom+diâmetro das armaduras, a altura da sapata é: "+H_com_ℓb+" cm";
linha35= "3.1.5.2 Verificação da compressão diagonal do concreto: ";
linha36= τSd<τRd2?("Pelas equações 12 e 13, tem-se: τSd = "+τSd+"Mpa ≤ τRd2= "+τRd2+" Mpa. Desse modo a verificação da compressão da diagonal do concreto é atendida"):(verificação_biela==("Na verificação da compressão diagonal do concreto, a altura calculada da sapata já foi aumentada em 30cm! Algo do projeto deve ser reavaliado no intuito de um dimensionamento do elemento estrutural mais adequado")?("Pelas equações 12 e 13, tem-se: τSd = "+τSd+"Mpa > τRd2= "+τRd2+" Mpa. Desse modo, na verificação da compressão diagonal do concreto, a altura calculada da sapata já foi aumentada em 30cm! Algo do projeto deve ser reavaliado no intuito de um dimensionamento do elemento estrutural mais adequado"):("Pelas equações 12 e 13, tem-se: τSd = "+τSd+"Mpa > τRd2= "+τRd2+" Mpa. Desse modo, na verificação da compressão diagonal do concreto, a altura calculada da sapata foi aumentada em "+cota_Verificação_da_diagonal+"cm"));
linha37= "3.1.5.3 Assim, com as verificações realizadas, a altura total da sapata é: H= "+H1+"cm";
linha38= "3.1.6 Dimensões superiores da sapata (a e b): esses valores podem variar das dimensões do pilar analisado, tendo em vista a possibilidade do projetista considerar colarinho da sapata, e o tamanho desse colarinho.";
linha39=  (a<acalculado?("colarinho considerado ="+colarinho+" cm"):"colarinho não considerado");
linha40= "Então: a= "+(a<acalculado?acalculado:a)+" cm"+ " e b= "+(b<bcalculado?bcalculado:b)+" cm";
Aviso= "AVISO: "+aviso_sobre_verificações_de_H;
Método = Proporção_do_Pilar_ou_Balanços_Iguais=="True"? "Balanços Iguais":"Proporção do Pilar";
Calculo_de_A = Proporção_do_Pilar_ou_Balanços_Iguais=="True"?"Pela Equação 05= ":"Pela Equação 06= ";
Calculo_de_B = Proporção_do_Pilar_ou_Balanços_Iguais=="True"?"Pela Equação 04= ":"Pela Equação 07= ";

linha41= "
AÇO CALCULADO PARA O ELEMENTO ESTRUTURAL ANALISADO";
linha42= "4.1 Armadura paralela a dimensão A:";
linha43= "4.1.1 Área de aço calculada (Asc):";
linha44= "pela equação 16, Asc= "+AscA1+" cm²";
linha45= "4.1.2 Área de aço mínima (Asmín):";
linha46= "pela equação 26, Asmín= "+AsmínA+" cm²";
linha47= "4.1.3 Área de considerada= "+(AscA1<AsmínA?AsmínA:AscA1)+" cm²";
linha48= "4.1.4 Quantidade de barras (n):";
linha49= "Considerando a quantidade mínima de 2 barras com a equação 21, n= "+ncA+" barras";
linha50= "4.1.4 Espaçamento (e):";
linha51= "pela equação 22, e= "+ecA+" cm";
linha52=(ecA>EAadot?("O espaçamento é superior ao limite estabelecido de "+ EAadot+" cm. Desse modo, considerando e="+ EAadot+" cm, n= "+nA+" barras. Assim, o espaçamento, recalculado, é "+EAfinal+" cm"):("Verificação: espaçamento menor que o limite estabelecido de "+ EAadot+" cm, OK!"));
ESPAÇAMENTOA=EA=="True"?linha52:(ecA>30?("O espaçamento é superior a 30 cm. Desse modo, considerando e=30, n= "+nA+" barras. Desse modo, o espaçamento, recalculado, é "+EAfinal+" cm"):("Verificação: espaçamento menor que 30 cm, OK!"));
linha53= "4.1.5 Comprimento Horizontal (CH):";
linha54= "CH= "+CHA+" cm";
linha55= "4.1.6 Comprimento vertical (CV):";
linha56= "Pela equação 23 e a tabela do item 9.4.2.3 da NBR 6118 (2023), CV= "+CVA+" cm";
linha57= "4.1.6 Comprimento de corte (C):";
linha58= "Pela equação 24 e a tabela do item 9.4.2.3 da NBR 6118 (2023), C= "+CA+" cm";
linha59= "4.2 Armadura paralela a dimensão B:";
linha60= "4.2.1 Área de aço calculada (Asc):";
linha61= "pela equação 16, Asc= "+AscB1+" cm²";
linha62= "4.2.2 Área de aço mínima (Asmín):";
linha63= "pela equação 26, Asmín= "+AsmínB+" cm²";
linha64= "4.2.3 Área de considerada= "+(AscB1<AsmínB?AsmínB:AscB1)+" cm²";
linha65= "4.2.4 Quantidade de barras (n):";
linha66= "Considerando a quantidade mínima de 2 barras com a equação 21, n= "+ncB+" barras";
linha67= "4.2.4 Espaçamento (e):";
linha68= "pela equação 22, e= "+ecB+" cm²";
linha69=(ecB>EBadot?("O espaçamento é superior ao limite estabelecido de "+ EBadot+" cm. Desse modo, considerando e="+ EBadot+" cm, n= "+nB+" barras. Assim, o espaçamento, recalculado, é "+EBfinal+" cm"):("Verificação: espaçamento menor que o limite estabelecido de "+ EBadot+" cm, OK!"));
ESPAÇAMENTOB=EB=="True"?linha69:(ecB>30?("O espaçamento é superior a 30 cm. Desse modo, considerando e=30, n= "+nB+" barras. Desse modo, o espaçamento, recalculado, é "+EBfinal+" cm"):("Verificação: espaçamento menor que 30 cm, OK!"));
linha70= "4.2.5 Comprimento Horizontal (CH):";
linha71= "CH= "+CHB+" cm";
linha72= "4.2.6 Comprimento vertical (CV):";
linha73= "Pela equação 23 e a tabela do item 9.4.2.3 da NBR 6118 (2023), CV= "+CVB+" cm";
linha74= "4.2.6 Comprimento de corte (C):";
linha75= "Pela equação 24 e a tabela do item 9.4.2.3 da NBR 6118 (2023), C= "+CB+" cm";
OBSERVAÇÃO= "OBSERVAÇÃO: é importante destacar que, no detalhamento, para o comprimento das cotas verticais, os valores serão iguais a maior cota calculada! Assim, a cota vertical detalhada será CV ="+CV+" cm. A cota vertical também interfere na altura h0 da sapata e, dessa forma, a verificação sempre será realizada. Assim, verificando se CV<h0, chega-se ao valor de h0 ="+h0+ " cm.";
RESUMO = "Portanto, considerando as alturas mínimas estabelecidas, o elemento estrutural apresenta:";
RESUMO1 ="DIMENSÕES GEOMÉTRICAS:";
Maior_dimensão_do_pilar="a = "+(a<acalculado?acalculado:a)+" cm";
Menor_dimensão_do_pilar="b = "+(b<bcalculado?bcalculado:b)+" cm";
AMaiordimensão = "A = "+A+"cm";
BMenordimensão = "B = "+B+"cm";
Alturasapata = "H = "+H+"cm";
alturah0sapata="H0 = "+H0F+"cm";
RESUMO2 ="ARMAÇÃO:";
ARMAÇÃOA= "Armadura distribuída ao longo de A= ";
ARMAÇÃOA1=armadura_a;
ARMAÇÃOB= "Armadura distribuída ao longo de B= ";
ARMAÇÃOB1=armadura_b;
RESUMO3 ="MATERIAIS:";
CONCRETO="Volume de concreto= "+Vconcreto +" m³";
AÇO="Peso de aço= "+Paço +" Kg";
// ----------------------------------------------------
// CRIAÇÃO DA LISTA FINAL PARA EXPORTAÇÃO
// ----------------------------------------------------

relatorio_final = [linha1,linha2,linha3,linha4,linha5,linha6,linha7,pilar,linha8,linha9,linha10,linha11,linha12,
linha13,linha14,linha15,adotadoH,adotadoH0,linha17,linha18,linha19,linha20,linha21,linha22,linha23,ꞃc1,
linha24,linha25,Arredondamento,linha26,linha27,linha28,linha29,linha30,linha31,linha32,
linha33,linha34,linha35,linha36,linha37,linha38,linha39,linha40,Aviso,linha41,linha42,linha43,linha44,linha45,
linha46,linha47,linha48,linha49,linha50,linha51,ESPAÇAMENTOA,linha53,linha54,linha55,linha56,linha57,linha58,linha59,linha60,
linha61,linha62,linha63,linha64,linha65,linha66,linha67,linha68,ESPAÇAMENTOB,linha70,linha71,linha72,linha73,linha74,linha75,OBSERVAÇÃO
,RESUMO,RESUMO1,Maior_dimensão_do_pilar,Menor_dimensão_do_pilar,
AMaiordimensão,BMenordimensão,Alturasapata,alturah0sapata,RESUMO2,
ARMAÇÃOA,ARMAÇÃOA1,ARMAÇÃOB,ARMAÇÃOB1,RESUMO3,CONCRETO,AÇO];

OUT = relatorio_final;
# ----------------------------------------
join = String.Join(separator=code_block_16, string0=code_block_17.OUT)
n02_relatório_de_calculo_criado = FileSystem.WriteText(filePath=code_block_15.ARQUIVO, text=join)  # "02 - RELATÓRIO DE CALCULO CRIADO: OK!"
n02_relatório_de_cálculo_do = Watch(n02_relatório_de_calculo_criado)  # "02 - RELATÓRIO DE CÁLCULO DO ELEMENTO ESTRUTURAL: OK!"; graph output
